# Dynamo graph 01_Generate-Takeoff.dyn (Dynamo 2.16.4.10216)

# group: Current Project
current = Document.Current()
filePath = Document.FilePath(document=current)

# group: Return the Folder of the Current Project
code_block = CodeBlock { "\\"; }
code_block_2 = CodeBlock { "\\"; }
split = String.Split(string=filePath, separator0=code_block_2)
code_block_3 = CodeBlock { -1; }
dropItems = List.DropItems(list=split, amount=code_block_3)
join = String.Join(separator=code_block, string0=dropItems)

# group: Choose Excel Template and Sheet to Work With
file_path = Filename("..\Templates\01_Takeoff.xlsx")
file_from_path = FileObject(path=file_path)

# group: Return the File Name of the Current Template
code_block_4 = CodeBlock { "\\"; }
code_block_5 = CodeBlock { "\\"; }
split_2 = String.Split(string=file_path, separator0=code_block_5)
lastItem = List.LastItem(list=split_2)
join_2 = String.Join(separator=code_block_4, string0=lastItem)

# group: Combine Into the Current Project Path and Template Name
code_block_6 = CodeBlock { "\\"; }
combinePath = FileSystem.CombinePath(string0=join, string1=join_2)
join_3 = String.Join(separator=code_block_6, string0=combinePath)

# group: RevitExtraction Sheet
code_block_7 = CodeBlock { "RevitExtraction"; }

# group: RevitExtraction Sheet > Excel Raw Extraction
code_block_8 = CodeBlock { 2; }

# group: Extract All Elements of Specialty Equipment
categories = Categories("OST_SpecialityEquipment")
all_elements_of_category = ElementsOfCategory(Category=categories)

code_block_9 = CodeBlock(x=all_elements_of_category) { x; }

# group: Write GUID (Global Unique Modifier) to List
string = StringInput("[R] GUID")
uniqueId = Element.UniqueId(element=code_block_9)
addItemToFront = List.AddItemToFront(item=string, list=uniqueId)

# group: Write Element ID (Specific to Project) to List
string_2 = StringInput("[R] Element ID")
id = Element.Id(element=code_block_9)
addItemToFront_2 = List.AddItemToFront(item=string_2, list=id)

# group: Write Element "[R] Family" Parameter to List
string_3 = StringInput("[R] Family")
code_block_10 = CodeBlock { "Family"; }
getParameterValueByName = Element.GetParameterValueByName(element=code_block_9, parameterName=code_block_10)
addItemToFront_3 = List.AddItemToFront(item=string_3, list=getParameterValueByName)
string_from_object = FromObject(object=addItemToFront_3)
python_script = Python(IN[0]=string_from_object)  # CPython3
# ---------- python_script.python (26 lines) ----------
# Load the Python Standard and DesignScript Libraries
import sys
import clr
clr.AddReference('ProtoGeometry')
from Autodesk.DesignScript.Geometry import *

# The inputs to this node will be stored as a list in the IN variables.
dataEnteringNode = IN

# Get the input list of strings from the first input port (IN[0])
strings = IN[0]

# Process each string to extract just the family name, but keep header as-is
cleaned = []
for i, s in enumerate(strings):
    if i == 0:  # If it's the header (first item)
        cleaned.append(s)  # Keep it unchanged
    else:
        # Find the position after "Family: "
        start_pos = s.find("Family: ") + len("Family: ")
        # Get everything after "Family: "
        cleaned_string = s[start_pos:]
        cleaned.append(cleaned_string)

# Assign your output to the OUT variable.
OUT = cleaned
# ----------------------------------------

# group: Write Phasing "Created" for Revit/Dynamo Population
string_4 = StringInput("[R] Created")
python_script_2 = Python(IN[0]=code_block_9)  # CPython3
# ---------- python_script_2.python (30 lines) ----------
import clr
clr.AddReference('RevitAPI')
clr.AddReference('RevitServices')
from Autodesk.Revit.DB import *
from RevitServices.Persistence import DocumentManager

# Get the current document
doc = DocumentManager.Instance.CurrentDBDocument

# Set the category to Specialty Equipment
category = BuiltInCategory.OST_SpecialityEquipment

# Initialize the output list for phase created information
specialty_equipment_phases_created = []

# Collect all elements in the Specialty Equipment category
collector = FilteredElementCollector(doc).OfCategory(category).WhereElementIsNotElementType()

for element in collector:
    # Get the Phase Created parameter
    phase_created = element.get_Parameter(BuiltInParameter.PHASE_CREATED)

    # Extract the phase name if available
    phase_created_name = phase_created.AsValueString() if phase_created else "N/A"

    # Append only the Phase Created information to the output list
    specialty_equipment_phases_created.append(phase_created_name)

# Output the phase created data for Specialty Equipment elements
OUT = specialty_equipment_phases_created
# ----------------------------------------
addItemToFront_4 = List.AddItemToFront(item=string_4, list=python_script_2)

# group: Write Phasing "Demolished" for Revit/Dynamo Population
string_5 = StringInput("[R] Demolish")
python_script_3 = Python(IN[0]=code_block_9)  # CPython3
# ---------- python_script_3.python (30 lines) ----------
import clr
clr.AddReference('RevitAPI')
clr.AddReference('RevitServices')
from Autodesk.Revit.DB import *
from RevitServices.Persistence import DocumentManager

# Get the current document
doc = DocumentManager.Instance.CurrentDBDocument

# Set the category to Specialty Equipment
category = BuiltInCategory.OST_SpecialityEquipment

# Initialize the output list for phase information
specialty_equipment_phases = []

# Collect all elements in the Specialty Equipment category
collector = FilteredElementCollector(doc).OfCategory(category).WhereElementIsNotElementType()

for element in collector:
    # Get Phase Demolished parameter
    phase_demolished = element.get_Parameter(BuiltInParameter.PHASE_DEMOLISHED)

    # Append the phase demolished information or empty string if not available
    if phase_demolished and phase_demolished.HasValue:
        specialty_equipment_phases.append(phase_demolished.AsValueString())
    else:
        specialty_equipment_phases.append("")  # Append empty string, Dynamo will interpret as Null

# Output only the Phase Demolished data for Specialty Equipment elements
OUT = specialty_equipment_phases
# ----------------------------------------
addItemToFront_5 = List.AddItemToFront(item=string_5, list=python_script_3)

# group: Write Element [ACI_Department] Parameter to List
string_6 = StringInput("[R] ACI Department")
string_7 = StringInput("ACI_Department")
getParameterValueByName_2 = Element.GetParameterValueByName(element=code_block_9, parameterName=string_7)
addItemToFront_6 = List.AddItemToFront(item=string_6, list=getParameterValueByName_2)

# group: Write Element "[O] CA: Department" Parameter to List
string_8 = StringInput("[O] CA: Department")
string_9 = StringInput("ACI_Sub-Department")
getParameterValueByName_3 = Element.GetParameterValueByName(element=code_block_9, parameterName=string_9)
addItemToFront_7 = List.AddItemToFront(item=string_8, list=getParameterValueByName_3)

# group: Write Element [ACI_Item-Name] Parameter (Type & Instance) to List
string_10 = StringInput("[R] ACI_Item Name")
input = CodeBlock(x=code_block_9) { x; }
string_11 = StringInput("ACI_Item-Name")
getParameterValueByName_4 = Element.GetParameterValueByName(element=input, parameterName=string_11)
elementType = Element.ElementType(element=input)
getParameterValueByName_5 = Element.GetParameterValueByName(element=elementType, parameterName=string_11)
python_script_4 = Python(IN[0]=getParameterValueByName_4, IN[1]=getParameterValueByName_5)  # CPython3
# ---------- python_script_4.python (47 lines) ----------
# Load the Python Standard and DesignScript Libraries
import sys
import clr
clr.AddReference('ProtoGeometry')
from Autodesk.DesignScript.Geometry import *

# The inputs to this node will be stored as a list in the IN variables.
dataEnteringNode = IN

# Inputs: Two lists to combine
list1 = IN[0]  # First input list (e.g., Instance Parameters)
list2 = IN[1]  # Second input list (e.g., Type Parameters)

# Ensure inputs are lists (handles Dynamo data structure issues)
list1 = list1 if isinstance(list1, list) else []
list2 = list2 if isinstance(list2, list) else []

# Combine logic: Preserving original indices and prioritizing non-null and non-blank values
combined_list = []
max_length = max(len(list1), len(list2))

for i in range(max_length):
    # Handle out-of-range indices gracefully
    val1 = list1[i] if i < len(list1) else None
    val2 = list2[i] if i < len(list2) else None

    # Normalize blank entries to None
    if val1 == "" or val1 == " ":
        val1 = None
    if val2 == "" or val2 == " ":
        val2 = None

    # Prioritize non-null and non-blank values, handle conflicts
    if val1 is not None and val2 is not None:
        if val1 == val2:
            combined_list.append(val1)  # If both values are the same, use it
        else:
            combined_list.append(val1)  # Prioritize list1's value
    elif val1 is not None:
        combined_list.append(val1)  # Use value from list1 if list2 is blank/null
    elif val2 is not None:
        combined_list.append(val2)  # Use value from list2 if list1 is blank/null
    else:
        combined_list.append(None)  # Both are blank/null, append None

# Assign your output to the OUT variable
OUT = combined_list
# ----------------------------------------
addItemToFront_8 = List.AddItemToFront(item=string_10, list=python_script_4)

# group: Write Element [Element.Name] Parameter to List
string_12 = StringInput("Family Type")
name = Element.Name(element=code_block_9)
addItemToFront_9 = List.AddItemToFront(item=string_12, list=name)

code_block_11 = CodeBlock(x=all_elements_of_category) { x; }

# group: Write Element [Height] Parameter (from Family) to List
string_13 = StringInput("Height")
elementType_2 = Element.ElementType(element=code_block_11)
string_14 = StringInput("ACI_Height")
getParameterValueByName_6 = Element.GetParameterValueByName(element=elementType_2, parameterName=string_14)
python_script_5 = Python(IN[0]=getParameterValueByName_6)  # CPython3
# ---------- python_script_5.python (12 lines) ----------
import clr
clr.AddReference('ProtoGeometry')
from Autodesk.DesignScript.Geometry import *

def IsNumber(item):
    try:
        float(item)
        return True
    except ValueError:
        return False

OUT = [IsNumber(item) for item in IN[0]];
# ----------------------------------------
filterByBoolMask = List.FilterByBoolMask(list=getParameterValueByName_6, mask=python_script_5)
code_block_12 = CodeBlock { 3; }
round = Math.Round(number=filterByBoolMask.in, digits=code_block_12)
addItemToFront_10 = List.AddItemToFront(item=string_13, list=round)

# group: Write Element [Width] Parameter (from Family) to List
string_15 = StringInput("Width")
elementType_3 = Element.ElementType(element=code_block_11)
string_16 = StringInput("ACI_Width")
getParameterValueByName_7 = Element.GetParameterValueByName(element=elementType_3, parameterName=string_16)
python_script_6 = Python(IN[0]=getParameterValueByName_7)  # CPython3; same code as python_script_5
filterByBoolMask_2 = List.FilterByBoolMask(list=getParameterValueByName_7, mask=python_script_6)
code_block_13 = CodeBlock { 3; }
round_2 = Math.Round(number=filterByBoolMask_2.in, digits=code_block_13)
addItemToFront_11 = List.AddItemToFront(item=string_15, list=round_2)

# group: Write Element [Height] Parameter (from Family) to List
string_17 = StringInput("Depth")
elementType_4 = Element.ElementType(element=code_block_11)
string_18 = StringInput("ACI_Depth")
getParameterValueByName_8 = Element.GetParameterValueByName(element=elementType_4, parameterName=string_18)
python_script_7 = Python(IN[0]=getParameterValueByName_8)  # CPython3; same code as python_script_5
filterByBoolMask_3 = List.FilterByBoolMask(list=getParameterValueByName_8, mask=python_script_7)
code_block_14 = CodeBlock { 3; }
round_3 = Math.Round(number=filterByBoolMask_3.in, digits=code_block_14)
addItemToFront_12 = List.AddItemToFront(item=string_17, list=round_3)

code_block_15 = CodeBlock(x=all_elements_of_category) { x; }

# group: Write Empty "[O] CA: Type" to Takeoff for Oracle Population
string_19 = StringInput("[O] CA: Type")
elementType_5 = Element.ElementType(element=code_block_15)
string_20 = StringInput("ACI_CA:Type")
getParameterValueByName_9 = Element.GetParameterValueByName(element=elementType_5, parameterName=string_20)
addItemToFront_13 = List.AddItemToFront(item=string_19, list=getParameterValueByName_9)

# group: Write Element [ACI_Category-Count] Parameter (from Family) to Takeoff
string_21 = StringInput("[R] CNT")
elementType_6 = Element.ElementType(element=code_block_15)
string_22 = StringInput("ACI_Category-Count")
getParameterValueByName_10 = Element.GetParameterValueByName(element=elementType_6, parameterName=string_22)
addItemToFront_14 = List.AddItemToFront(item=string_21, list=getParameterValueByName_10)

# group: Write Empty "[O] CA: Count" to Takeoff for Oracle Population
string_23 = StringInput("[O] CNT")
elementType_7 = Element.ElementType(element=code_block_15)
string_24 = StringInput("ACI_CA:Count")
getParameterValueByName_11 = Element.GetParameterValueByName(element=elementType_7, parameterName=string_24)
addItemToFront_15 = List.AddItemToFront(item=string_23, list=getParameterValueByName_11)

# group: Write Element [ACI_Category-Lineal] Parameter (from Family) to List
string_25 = StringInput("[R] LF")
elementType_8 = Element.ElementType(element=code_block_15)
string_26 = StringInput("ACI_Category-Lineal")
getParameterValueByName_12 = Element.GetParameterValueByName(element=elementType_8, parameterName=string_26)
addItemToFront_16 = List.AddItemToFront(item=string_25, list=getParameterValueByName_12)

# group: Write Empty "[O] CA: LF" to Takeoff for Oracle Population
string_27 = StringInput("[O] LF")
elementType_9 = Element.ElementType(element=code_block_15)
string_28 = StringInput("ACI_CA:LF")
getParameterValueByName_13 = Element.GetParameterValueByName(element=elementType_9, parameterName=string_28)
addItemToFront_17 = List.AddItemToFront(item=string_27, list=getParameterValueByName_13)

# group: Write Element [ACI_Category-Lineal-Shelf] Parameter (from Family) to List
string_29 = StringInput("[R] LSF")
elementType_10 = Element.ElementType(element=code_block_15)
string_30 = StringInput("ACI_Category-Lineal-Shelf")
getParameterValueByName_14 = Element.GetParameterValueByName(element=elementType_10, parameterName=string_30)
addItemToFront_18 = List.AddItemToFront(item=string_29, list=getParameterValueByName_14)

# group: Write Empty "[O] CA: LSF" to Takeoff for Oracle Population
string_31 = StringInput("[O] LSF")
elementType_11 = Element.ElementType(element=code_block_15)
string_32 = StringInput("ACI_CA: LSF")
getParameterValueByName_15 = Element.GetParameterValueByName(element=elementType_11, parameterName=string_32)
addItemToFront_19 = List.AddItemToFront(item=string_31, list=getParameterValueByName_15)

code_block_16 = CodeBlock(x=all_elements_of_category) { x; }

# group: Write Element [ACI_Supplier] Parameter (Type & Instance) to List
string_33 = StringInput("[R] ACI_Supplier")
input_2 = CodeBlock(x=code_block_16) { x; }
string_34 = StringInput("ACI_Supplier")
getParameterValueByName_16 = Element.GetParameterValueByName(element=input_2, parameterName=string_34)
elementType_12 = Element.ElementType(element=input_2)
getParameterValueByName_17 = Element.GetParameterValueByName(element=elementType_12, parameterName=string_34)
python_script_8 = Python(IN[0]=getParameterValueByName_16, IN[1]=getParameterValueByName_17)  # CPython3; same code as python_script_4
addItemToFront_20 = List.AddItemToFront(item=string_33, list=python_script_8)

# group: Write Empty Supplier for Oracle Population
string_35 = StringInput("[O] Supplier")
empty = List.Empty()
addItemToFront_21 = List.AddItemToFront(item=string_35, list=empty)

# group: Write Element [ACI_Supplier-Item] Parameter (Type & Instance) to List
string_36 = StringInput("[R] ACI_Supplier Item")
input_3 = CodeBlock(x=code_block_16) { x; }
string_37 = StringInput("ACI_Supplier-Item")
getParameterValueByName_18 = Element.GetParameterValueByName(element=input_3, parameterName=string_37)
elementType_13 = Element.ElementType(element=input_3)
getParameterValueByName_19 = Element.GetParameterValueByName(element=elementType_13, parameterName=string_37)
python_script_9 = Python(IN[0]=getParameterValueByName_18, IN[1]=getParameterValueByName_19)  # CPython3; same code as python_script_4
addItemToFront_22 = List.AddItemToFront(item=string_36, list=python_script_9)

# group: Write Empty "Supplier Item" for Oracle Population
string_38 = StringInput("[O] Supplier Item")
empty_2 = List.Empty()
addItemToFront_23 = List.AddItemToFront(item=string_38, list=empty_2)

# group: Write Empty "[D] Strength" Item for Dynamo Population
string_39 = StringInput("[D] Strength")
empty_3 = List.Empty()
addItemToFront_24 = List.AddItemToFront(item=string_39, list=empty_3)

code_block_17 = CodeBlock(x=code_block_8) { x; }
code_block_18 = CodeBlock(x=code_block_17) { x; }

# group: Header Row
number = DoubleInput(2)
add = code_block_18 + number

code_block_19 = CodeBlock(x=code_block_16) { x; }

# group: Write "Is Match" = "No" for Manual Excel Population
string_40 = StringInput("Is Match?")
count = List.Count(list=code_block_19)
sequence = Sequence(start=add, amount=count)
code_block_20 = CodeBlock(row=sequence) { List.Repeat("No", List.Count(row)); }
addItemToFront_25 = List.AddItemToFront(item=string_40, list=code_block_20)

# group: Write Element [ACI_Item-Note] Parameter (from Project?) to List
string_41 = StringInput("[R] ACI_Item Note")
string_42 = StringInput("ACI_Item-Note")
getParameterValueByName_20 = Element.GetParameterValueByName(element=code_block_16, parameterName=string_42)
addItemToFront_26 = List.AddItemToFront(item=string_41, list=getParameterValueByName_20)

# group: Write Empty Description for Oracle Population
string_43 = StringInput("[O] Description")
empty_4 = List.Empty()
addItemToFront_27 = List.AddItemToFront(item=string_43, list=empty_4)

# group: Write Element [ACI_Category] Parameter (Type & Instance) to List
string_44 = StringInput("[R] ACI_Category")
input_4 = CodeBlock(x=code_block_16) { x; }
string_45 = StringInput("ACI_Category")
getParameterValueByName_21 = Element.GetParameterValueByName(element=input_4, parameterName=string_45)
elementType_14 = Element.ElementType(element=input_4)
getParameterValueByName_22 = Element.GetParameterValueByName(element=elementType_14, parameterName=string_45)
python_script_10 = Python(IN[0]=getParameterValueByName_21, IN[1]=getParameterValueByName_22)  # CPython3; same code as python_script_4
addItemToFront_28 = List.AddItemToFront(item=string_44, list=python_script_10)

# group: Write Empty Revit EQ Category for Oracle Population
string_46 = StringInput("[O] Revit EQ Category")
empty_5 = List.Empty()
addItemToFront_29 = List.AddItemToFront(item=string_46, list=empty_5)

# group: Write Element [ACI_Equipment-Tag] Parameter (Type & Instance) to List
string_47 = StringInput("[R] ACI Equipment Tag")
input_5 = CodeBlock(x=code_block_16) { x; }
string_48 = StringInput("ACI_Equipment-Tag")
getParameterValueByName_23 = Element.GetParameterValueByName(element=input_5, parameterName=string_48)
elementType_15 = Element.ElementType(element=input_5)
getParameterValueByName_24 = Element.GetParameterValueByName(element=elementType_15, parameterName=string_48)
python_script_11 = Python(IN[0]=getParameterValueByName_23, IN[1]=getParameterValueByName_24)  # CPython3; same code as python_script_4
addItemToFront_30 = List.AddItemToFront(item=string_47, list=python_script_11)

# group: Write Empty Revit EQ Tag for Oracle Population
string_49 = StringInput("[O] Revit EQ Tag")
empty_6 = List.Empty()
addItemToFront_31 = List.AddItemToFront(item=string_49, list=empty_6)

# group: Write Element [ACI_URL] Parameter (Type & Instance) to List
string_50 = StringInput("[R] URL")
input_6 = CodeBlock(x=code_block_16) { x; }
string_51 = StringInput("ACI_URL")
getParameterValueByName_25 = Element.GetParameterValueByName(element=input_6, parameterName=string_51)
elementType_16 = Element.ElementType(element=input_6)
getParameterValueByName_26 = Element.GetParameterValueByName(element=elementType_16, parameterName=string_51)
python_script_12 = Python(IN[0]=getParameterValueByName_25, IN[1]=getParameterValueByName_26)  # CPython3; same code as python_script_4
addItemToFront_32 = List.AddItemToFront(item=string_50, list=python_script_12)

# group: Write Empty Attachment URL for Oracle Population
string_52 = StringInput("[O] Attachment URL")
empty_7 = List.Empty()
addItemToFront_33 = List.AddItemToFront(item=string_52, list=empty_7)

# group: Write Concatenation Formula to Excel Column
string_53 = StringInput("Concatenation")
count_2 = List.Count(list=code_block_19)
sequence_2 = Sequence(start=add, amount=count_2)
code_block_21 = CodeBlock(row=sequence_2) { "=TEXTJOIN(\"-\", TRUE, C" + String.FromObject(row) + ", H" + String.FromObject(row) + ", I" + String.FromObject(row) + ", J" + String.FromObject(row) + ", K" + String.FromObject(row) + ", L" + String.FromObject(row) + ")"; }
addItemToFront_34 = List.AddItemToFront(item=string_53, list=code_block_21)

# group: Cleanup
list_create = List.Create(item0=addItemToFront, item1=addItemToFront_2, item2=python_script, item3=addItemToFront_4, item4=addItemToFront_5, item5=addItemToFront_6, item6=addItemToFront_7, item7=addItemToFront_8, item8=addItemToFront_9)
list_create_2 = List.Create(item0=addItemToFront_10, item1=addItemToFront_11, item2=addItemToFront_12)
list_create_3 = List.Create(item0=addItemToFront_13, item1=addItemToFront_14, item2=addItemToFront_15, item3=addItemToFront_16, item4=addItemToFront_17, item5=addItemToFront_18, item6=addItemToFront_19)
list_create_4 = List.Create(item0=addItemToFront_20, item1=addItemToFront_21, item2=addItemToFront_22, item3=addItemToFront_23, item4=addItemToFront_24)
list_create_5 = List.Create(item0=addItemToFront_25)
list_create_6 = List.Create(item0=addItemToFront_26, item1=addItemToFront_27, item2=addItemToFront_28, item3=addItemToFront_29, item4=addItemToFront_30, item5=addItemToFront_31, item6=addItemToFront_32, item7=addItemToFront_33)
list_create_7 = List.Create(item0=addItemToFront_34)

# group: Combine and Transpose Lists
join_4 = List.Join(list0=list_create, list1=list_create_2, list2=list_create_3, list3=list_create_4, list4=list_create_5, list5=list_create_6, list6=list_create_7)
transpose = List.Transpose(lists=join_4)

# group: Iterate Through the Headers
count_3 = List.Count(list=join_4)
sequence_3 = Sequence(amount=count_3)

# group (continued): RevitExtraction Sheet > Excel Raw Extraction
exportToExcel = Data.ExportToExcel(filePath=join_3, sheetName=code_block_7, startRow=code_block_8, startColumn=sequence_3, data=transpose)

# group: RevitExtraction Sheet > Excel Write Current Project
code_block_22 = CodeBlock { 0; }
code_block_23 = CodeBlock { 1; }
exportToExcel_2 = Data.ExportToExcel(filePath=join_3, sheetName=code_block_7, startRow=code_block_22, startColumn=code_block_23, data=filePath)

# group: Make a Copy of the Template in the Project Folder
boolean = BoolSelector(true)
copyFile = FileSystem.CopyFile(file=file_from_path, destinationPath=join_3, overwrite=boolean)
