# Dynamo graph 02_Create-Master-Check.dyn (Dynamo 2.16.4.10216)

# group: Current Project
current = Document.Current()
filePath = Document.FilePath(document=current)

# group: Return the Folder of the Current Project
code_block = CodeBlock { "\\"; }
code_block_2 = CodeBlock { "\\"; }
split = String.Split(string=filePath, separator0=code_block_2)
code_block_3 = CodeBlock { -1; }
dropItems = List.DropItems(list=split, amount=code_block_3)
join = String.Join(separator=code_block, string0=dropItems)

# group: Takeoff Template Location
file_path = Filename("Templates\01_Takeoff.xlsx")
file_from_path = FileObject(path=file_path)
string_from_object = FromObject(object=file_from_path)

# group: Return the File Name of the Takeoff Template
code_block_4 = CodeBlock { "\\"; }
code_block_5 = CodeBlock { "\\"; }
split_2 = String.Split(string=string_from_object, separator0=code_block_5)
lastItem = List.LastItem(list=split_2)
join_2 = String.Join(separator=code_block_4, string0=lastItem)

# group: Combine Into the Current Project Path and Template Name for Takeoff
code_block_6 = CodeBlock { "\\"; }
combinePath = FileSystem.CombinePath(string0=join, string1=join_2)
join_3 = String.Join(separator=code_block_6, string0=combinePath)

# group: Master Check Template Location
file_path_2 = Filename("Templates\02_Master-Check.xlsx")
file_from_path_2 = FileObject(path=file_path_2)
string_from_object_2 = FromObject(object=file_from_path_2)

# group: Return the File Name of the Master Check Template
code_block_7 = CodeBlock { "\\"; }
code_block_8 = CodeBlock { "\\"; }
split_3 = String.Split(string=string_from_object_2, separator0=code_block_8)
lastItem_2 = List.LastItem(list=split_3)
join_4 = String.Join(separator=code_block_7, string0=lastItem_2)

# group: Combine Into the Current Project Path and Template Name for CheckMaster
code_block_9 = CodeBlock { "\\"; }
combinePath_2 = FileSystem.CombinePath(string0=join, string1=join_4)
join_5 = String.Join(separator=code_block_9, string0=combinePath_2)

# group: Make a Copy of the Template in the Project Folder
file_from_path_3 = FileObject(path=join_3)
boolean = BoolSelector(true)
copyFile = FileSystem.CopyFile(file=file_from_path_3, destinationPath=join_5, overwrite=boolean)
