# Dynamo graph 03_Check-Against-Master.dyn (Dynamo 2.16.4.10216)

# group: Current Project
current = Document.Current()
filePath = Document.FilePath(document=current)

# group: Return the Folder of the Current Project
code_block = CodeBlock { "\\"; }
code_block_2 = CodeBlock { "\\"; }
split = String.Split(string=filePath, separator0=code_block_2)
code_block_3 = CodeBlock { -1; }
dropItems = List.DropItems(list=split, amount=code_block_3)
join = String.Join(separator=code_block, string0=dropItems)

# group: Master Check Template Location
file_path = Filename("Templates\02_Master-Check.xlsx")
file_from_path = FileObject(path=file_path)
string_from_object = FromObject(object=file_from_path)

# group: Return the File Name of the Master Check Template
code_block_4 = CodeBlock { "\\"; }
code_block_5 = CodeBlock { "\\"; }
split_2 = String.Split(string=string_from_object, separator0=code_block_5)
lastItem = List.LastItem(list=split_2)
join_2 = String.Join(separator=code_block_4, string0=lastItem)

# group: Combine Into the Current Project Path and Template Name for Master Check
code_block_6 = CodeBlock { "\\"; }
combinePath = FileSystem.CombinePath(string0=join, string1=join_2)
join_3 = String.Join(separator=code_block_6, string0=combinePath)

file_path_2 = CodeBlock(x=join_3) { x; }
file_path_3 = CodeBlock(x=file_path_2) { x; }
file_path_4 = CodeBlock(x=file_path_3) { x; }
sheet_name = CodeBlock { "RevitExtraction"; }
start_row = CodeBlock { 3; }

# group: Takeoff Template Location
file_path_5 = Filename("Templates\01_Takeoff.xlsx")
file_from_path_2 = FileObject(path=file_path_5)
string_from_object_2 = FromObject(object=file_from_path_2)

# group: Return the File Name of the Takeoff Template
code_block_7 = CodeBlock { "\\"; }
code_block_8 = CodeBlock { "\\"; }
split_3 = String.Split(string=string_from_object_2, separator0=code_block_8)
lastItem_2 = List.LastItem(list=split_3)
join_4 = String.Join(separator=code_block_7, string0=lastItem_2)

# group: Combine Into the Current Project Path and Template Name for Takeoff
code_block_9 = CodeBlock { "\\"; }
combinePath_2 = FileSystem.CombinePath(string0=join, string1=join_4)
join_5 = String.Join(separator=code_block_9, string0=combinePath_2)

# group: Read from Takeoff Excel
file_from_path_3 = FileObject(path=join_5)
string = StringInput("RevitExtraction")
boolean = BoolSelector(true)
importExcel = Data.ImportExcel(file=file_from_path_3, sheetName=string, showExcel=boolean)

# group: Extract "[O] Supplier Item" Index from Takeoff to Write into Master Check
firstItem = List.FirstItem(list=importExcel)
code_block_10 = CodeBlock { 2; }
getItemAtIndex = List.GetItemAtIndex(list=firstItem, index=code_block_10)
string_2 = StringInput("[O] Supplier Item")
indexOf = List.IndexOf(list=getItemAtIndex, element=string_2)

start_column = CodeBlock(x=indexOf) { x; }
start_column_2 = CodeBlock(x=start_column) { x; }

# group: Current Master Family List
file_path_6 = Filename("C:\Users\micha\OneDrive - Safeway, Inc\Documents\__Projects\x17 (Lineal Footage Analysis)\Oracle Revit Cutsheets-1-7-25 TCS Release.xlsx")
file_from_path_4 = FileObject(path=file_path_6)
string_3 = StringInput("Master")
boolean_2 = BoolSelector(false)
importExcel_2 = Data.ImportExcel(file=file_from_path_4, sheetName=string_3, showExcel=boolean_2)

# group: Extract "Supplier Item" from Master Family List (List 1)
transpose = List.Transpose(lists=importExcel_2)
firstItem_2 = List.FirstItem(list=importExcel_2)
string_4 = StringInput("Supplier Item")
indexOf_2 = List.IndexOf(list=firstItem_2, element=string_4)
getItemAtIndex_2 = List.GetItemAtIndex(list=transpose, index=indexOf_2)
code_block_11 = CodeBlock { 0; }
dropItems_2 = List.DropItems(list=getItemAtIndex_2, amount=code_block_11)

# group: Extract "[R] ACI_Supplier Item" from Takeoff to Test for (List 2)
firstItem_3 = List.FirstItem(list=importExcel)
transpose_2 = List.Transpose(lists=firstItem_3)
code_block_12 = CodeBlock { 2; }
getItemAtIndex_3 = List.GetItemAtIndex(list=firstItem_3, index=code_block_12)
string_5 = StringInput("[R] ACI_Supplier Item")
indexOf_3 = List.IndexOf(list=getItemAtIndex_3, element=string_5)
getItemAtIndex_4 = List.GetItemAtIndex(list=transpose_2, index=indexOf_3)
code_block_13 = CodeBlock { 0; }
dropItems_3 = List.DropItems(list=getItemAtIndex_4, amount=code_block_13)

# group: Search Below Row
weight = CodeBlock { 3; }

# group: Perfect Match Logic = 1
weight_2 = CodeBlock { 1; }
output_matches_and_indices = Python(IN[0]=dropItems_2, IN[1]=dropItems_3, IN[2]=weight_2, IN[3]=weight)  # CPython3
# ---------- output_matches_and_indices.python (59 lines) ----------
# Load the Python Standard and DesignScript Libraries
import sys
import clr
clr.AddReference('ProtoGeometry')
from Autodesk.DesignScript.Geometry import *

# The inputs to this node will be stored as a list in the IN variables.
dataEnteringNode = IN

# Inputs (maintain original order):
MasterFamilyList = IN[0]  # List1: Master Family List (source for matches)
TakeoffList = IN[1]       # List2: Takeoff List (to find matches in Master Family List)
weight_perfect = IN[2]    # Weight for perfect matches (e.g., 1)
start_row = IN[3]         # Row number to start searching (0-indexed)

# Initialize empty output lists
matched_items = [None] * len(TakeoffList)       # For matched items from MasterFamilyList
matched_indices = [None] * len(TakeoffList)     # For the indices of the matched items in MasterFamilyList
reordered_items = [None] * len(TakeoffList)     # Reordered matches based on TakeoffList
weights = [0] * len(TakeoffList)                # Weights for each match (perfect match weight or 0)

# Function to clean a value by removing non-alphanumeric characters (except numbers) and converting to lowercase
def clean_value(v):
    if v is None:
        return ""  # Return empty string if input is None
    if isinstance(v, (int, float)):  # Convert numbers to strings without unnecessary precision
        v = str(int(v)) if float(v).is_integer() else str(v)
    else:
        v = str(v)  # Ensure the input is a string
    v = ''.join(char for char in v if char.isalnum() or char.isdigit())  # Remove non-alphanumeric characters but keep digits
    return v.lower()  # Convert to lowercase for uniformity

# Iterate through TakeoffList (List2) and check for perfect matches in MasterFamilyList (List1)
for idx, item2 in enumerate(TakeoffList):
    if item2 is None or item2 == "":
        continue  # Skip if item2 is None or empty
    
    clean_item2 = clean_value(item2)
    
    # Iterate through MasterFamilyList (List1) for potential matches, starting at start_row
    for i, item1 in enumerate(MasterFamilyList):
        if i < start_row:
            continue  # Skip rows above the start_row
        if item1 is None or item1 == "":
            continue  # Skip if item1 is None or empty
        
        clean_item1 = clean_value(item1)
        
        # Check for a perfect match
        if clean_item1 == clean_item2:
            # If a match is found, update the output lists at the original index of TakeoffList
            matched_items[idx] = MasterFamilyList[i]    # Matched item from MasterFamilyList
            matched_indices[idx] = i                    # Index of the match in MasterFamilyList
            reordered_items[idx] = MasterFamilyList[i]  # Reorder matches based on TakeoffList
            weights[idx] = weight_perfect               # Assign perfect match weight
            break

# Output tuple with matched items (from MasterFamilyList), matched indices, reordered matches (from MasterFamilyList), and weights
OUT = (matched_items, matched_indices, reordered_items, weights)
# ----------------------------------------
code_block_14 = CodeBlock { 0; }
list_getitematindex_mfl_list_1 = List.GetItemAtIndex(list=output_matches_and_indices, index=code_block_14)  # "List.GetItemAtIndex "MFL (List 1): Supplier Item""
code_block_15 = CodeBlock { 2; }
list_getitematindex_takeoff_list = List.GetItemAtIndex(list=output_matches_and_indices, index=code_block_15)  # "List.GetItemAtIndex "Takeoff (List 2): ACI_Supplier Item""
code_block_16 = CodeBlock { 1; }
list_getitematindex_indices = List.GetItemAtIndex(list=output_matches_and_indices, index=code_block_16)

# group: Cleanup
tuple = CodeBlock(x=output_matches_and_indices) { x; }
mfl_list_1 = CodeBlock(x=list_getitematindex_mfl_list_1) { x; }
takeoff_list_2 = CodeBlock(x=list_getitematindex_takeoff_list) { x; }
indices = CodeBlock(x=list_getitematindex_indices) { x; }

# group: Partial Match Logic = 2
minimum_char_match = CodeBlock { 6; }
weight_3 = CodeBlock { 2; }
output_matches_and_indices_2 = Python(IN[0]=dropItems_2, IN[1]=dropItems_3, IN[2]=minimum_char_match, IN[3]=weight_3, IN[4]=weight)  # CPython3
# ---------- output_matches_and_indices_2.python (56 lines) ----------
# Load the Python Standard and DesignScript Libraries
import sys
import clr
clr.AddReference('ProtoGeometry')
from Autodesk.DesignScript.Geometry import *

# The inputs to this node will be stored as a list in the IN variables.
dataEnteringNode = IN

# Inputs:
MasterFamilyList = IN[0]  # List1: Master Family List (source for matches)
TakeoffList = IN[1]       # List2: Takeoff List (to find partial matches in Master Family List)
min_chars = IN[2]         # Minimum number of consecutive matching characters
weight_partial = IN[3]    # Weight for partial matches (e.g., 1)
header_row = IN[4]        # Row number of the header in the Excel file (typically 3)

# Initialize output lists with None to preserve order and length
matched_items = [None] * len(TakeoffList)       # For matched items found in MasterFamilyList based on criteria from TakeoffList
matched_criteria_indices = [None] * len(TakeoffList)  # The original indices of the matching criteria from TakeoffList
matched_criteria_items = [None] * len(TakeoffList)  # The value from TakeoffList used as match criteria
weights = [None] * len(TakeoffList)  # Weights for each match (only assigned if there is a match)

# Function to clean a string by removing non-alphanumeric characters and spaces, and converting to lowercase
def clean_string(s):
    s = str(int(s)) if isinstance(s, (int, float)) and s.is_integer() else str(s)  # Convert to string without adding .0 for integers
    s = ''.join(char for char in s if char.isalnum() or char.isspace())
    s = s.lower()  # Convert to lowercase
    return s

# Iterate through TakeoffList (List2) and check for partial matches in MasterFamilyList (List1)
for idx2, item2 in enumerate(TakeoffList):
    if idx2 < header_row or not item2:  # Skip header rows and empty values
        continue
    
    found_match = False
    clean_item2 = clean_string(item2)
    
    # Iterate through MasterFamilyList (List1) for potential matches
    for i, item1 in enumerate(MasterFamilyList):
        if i < header_row:  # Skip header rows
            continue
        
        clean_item1 = clean_string(item1)
        
        # Check for a partial match based on the minimum characters (concurrent matching)
        if len(clean_item2) >= min_chars and clean_item2[:min_chars] in clean_item1:
            # If a match is found, update the output lists at the correct index (idx2)
            matched_items[idx2] = str(int(MasterFamilyList[i])) if isinstance(MasterFamilyList[i], (int, float)) and MasterFamilyList[i].is_integer() else str(MasterFamilyList[i])  # Matched item from MasterFamilyList
            matched_criteria_indices[idx2] = idx2  # Keep the original index from TakeoffList
            matched_criteria_items[idx2] = item2  # Append the item from TakeoffList used as match criteria
            weights[idx2] = weight_partial  # Assign partial match weight
            found_match = True
            break

# Output tuple with matched items (from MasterFamilyList), matched indices, reordered matches (from MasterFamilyList), and weights
OUT = (matched_items, matched_criteria_indices, matched_criteria_items, weights)
# ----------------------------------------
code_block_17 = CodeBlock { 0; }
list_getitematindex_mfl_list_1_2 = List.GetItemAtIndex(list=output_matches_and_indices_2, index=code_block_17)  # "List.GetItemAtIndex "MFL (List 1): Supplier Item""
code_block_18 = CodeBlock { 2; }
list_getitematindex_takeoff_list_2 = List.GetItemAtIndex(list=output_matches_and_indices_2, index=code_block_18)  # "List.GetItemAtIndex "Takeoff (List 2): ACI_Supplier Item""
code_block_19 = CodeBlock { 1; }
list_getitematindex_indices_2 = List.GetItemAtIndex(list=output_matches_and_indices_2, index=code_block_19)

# group: Cleanup
tuple_2 = CodeBlock(x=output_matches_and_indices_2) { x; }
mfl_list_1_2 = CodeBlock(x=list_getitematindex_mfl_list_1_2) { x; }
takeoff_list_2_2 = CodeBlock(x=list_getitematindex_takeoff_list_2) { x; }
indices_2 = CodeBlock(x=list_getitematindex_indices_2) { x; }

# group: Partial Match Logic = 3
minimum_char_match_2 = CodeBlock { 5; }
weight_4 = CodeBlock { 3; }
output_matches_and_indices_3 = Python(IN[0]=dropItems_2, IN[1]=dropItems_3, IN[2]=minimum_char_match_2, IN[3]=weight_4, IN[4]=weight)  # CPython3; same code as output_matches_and_indices_2
code_block_20 = CodeBlock { 0; }
list_getitematindex_mfl_list_1_3 = List.GetItemAtIndex(list=output_matches_and_indices_3, index=code_block_20)  # "List.GetItemAtIndex "MFL (List 1): Supplier Item""
code_block_21 = CodeBlock { 2; }
list_getitematindex_takeoff_list_3 = List.GetItemAtIndex(list=output_matches_and_indices_3, index=code_block_21)  # "List.GetItemAtIndex "Takeoff (List 2): ACI_Supplier Item""
code_block_22 = CodeBlock { 1; }
list_getitematindex_indices_3 = List.GetItemAtIndex(list=output_matches_and_indices_3, index=code_block_22)

# group: Cleanup
tuple_3 = CodeBlock(x=output_matches_and_indices_3) { x; }
mfl_list_1_3 = CodeBlock(x=list_getitematindex_mfl_list_1_3) { x; }
takeoff_list_2_3 = CodeBlock(x=list_getitematindex_takeoff_list_3) { x; }
indices_3 = CodeBlock(x=list_getitematindex_indices_3) { x; }

# group: Partial Match Logic = 4
minimum_char_match_3 = CodeBlock { 4; }
weight_5 = CodeBlock { 4; }
output_matches_and_indices_4 = Python(IN[0]=dropItems_2, IN[1]=dropItems_3, IN[2]=minimum_char_match_3, IN[3]=weight_5, IN[4]=weight)  # CPython3; same code as output_matches_and_indices_2
code_block_23 = CodeBlock { 0; }
list_getitematindex_mfl_list_1_4 = List.GetItemAtIndex(list=output_matches_and_indices_4, index=code_block_23)  # "List.GetItemAtIndex "MFL (List 1): Supplier Item""
code_block_24 = CodeBlock { 2; }
list_getitematindex_takeoff_list_4 = List.GetItemAtIndex(list=output_matches_and_indices_4, index=code_block_24)  # "List.GetItemAtIndex "Takeoff (List 2): ACI_Supplier Item""
code_block_25 = CodeBlock { 1; }
list_getitematindex_indices_4 = List.GetItemAtIndex(list=output_matches_and_indices_4, index=code_block_25)

# group: Cleanup
tuple_4 = CodeBlock(x=output_matches_and_indices_4) { x; }
mfl_list_1_4 = CodeBlock(x=list_getitematindex_mfl_list_1_4) { x; }
takeoff_list_2_4 = CodeBlock(x=list_getitematindex_takeoff_list_4) { x; }
indices_4 = CodeBlock(x=list_getitematindex_indices_4) { x; }

# group: Partial Match Logic = 5
minimum_char_match_4 = CodeBlock { 3; }
weight_6 = CodeBlock { 5; }
output_matches_and_indices_5 = Python(IN[0]=dropItems_2, IN[1]=dropItems_3, IN[2]=minimum_char_match_4, IN[3]=weight_6, IN[4]=weight)  # CPython3; same code as output_matches_and_indices_2
code_block_26 = CodeBlock { 0; }
list_getitematindex_mfl_list_1_5 = List.GetItemAtIndex(list=output_matches_and_indices_5, index=code_block_26)  # "List.GetItemAtIndex "MFL (List 1): Supplier Item""
code_block_27 = CodeBlock { 2; }
list_getitematindex_takeoff_list_5 = List.GetItemAtIndex(list=output_matches_and_indices_5, index=code_block_27)  # "List.GetItemAtIndex "Takeoff (List 2): ACI_Supplier Item""
code_block_28 = CodeBlock { 1; }
list_getitematindex_indices_5 = List.GetItemAtIndex(list=output_matches_and_indices_5, index=code_block_28)

# group: Cleanup
tuple_5 = CodeBlock(x=output_matches_and_indices_5) { x; }
mfl_list_1_5 = CodeBlock(x=list_getitematindex_mfl_list_1_5) { x; }
takeoff_list_2_5 = CodeBlock(x=list_getitematindex_takeoff_list_5) { x; }
indices_5 = CodeBlock(x=list_getitematindex_indices_5) { x; }

drop_headers = CodeBlock { 3; }

# group: Weighting Logic
python_script = Python(IN[0]=tuple, IN[1]=tuple_2, IN[2]=tuple_3, IN[3]=tuple_4, IN[4]=tuple_5, IN[5]=drop_headers)  # CPython3
# ---------- python_script.python (69 lines) ----------
# Load necessary libraries
import clr
clr.AddReference('ProtoGeometry')
from Autodesk.DesignScript.Geometry import *

# Inputs: Each input is a tuple of four lists: (items, indices, reordered_items, weights)
perfect_match = IN[0]
partial_match_1 = IN[1]
partial_match_2 = IN[2]
partial_match_3 = IN[3]
partial_match_4 = IN[4]
rows_to_drop = IN[5]  # Number of starting rows to drop

# Initialize output lists
final_matched_items = []       # Best matched items from Master Family List
final_matched_indices = []     # Indices corresponding to the best matched items in Master Family List
final_weights = []             # Weights for each match, with lower weight indicating higher priority
match_criteria = []            # Original match criteria from input matches (used to verify alignment with Takeoff)

# List of all match types for easier iteration
all_matches = [perfect_match, partial_match_1, partial_match_2, partial_match_3, partial_match_4]

# Determine the length of the shortest list in the matches (to avoid out-of-range errors)
min_length = min(len(match[0]) for match in all_matches if len(match) == 4)

# Adjust min_length to account for rows to drop
min_length = max(0, min_length - rows_to_drop)

# Process each index in the input lists, starting after the dropped rows
for i in range(rows_to_drop, rows_to_drop + min_length):
    best_match = None
    best_index = None
    best_weight = None  # Start with None to signify no match found yet

    # Iterate through each match type to determine the best match for this index
    for match_type in all_matches:
        # Ensure the match_type tuple has exactly four components to prevent unpacking errors
        if len(match_type) != 4:
            continue

        items, indices, reordered_items, weights = match_type  # Extract components from the match tuple
        
        # Ensure that we do not exceed the bounds of any of the lists
        if i >= len(items) or i >= len(indices) or i >= len(weights):
            continue
        
        item = items[i]
        index = indices[i]
        weight = weights[i]

        # Select the item with the lowest weight (highest priority)
        if item is not None and (best_weight is None or weight < best_weight):
            best_match = item
            best_index = index
            best_weight = weight

    # Append the best match found for this index
    final_matched_items.append(best_match if best_match is not None else None)
    final_matched_indices.append(best_index if best_index is not None else None)
    match_criteria.append(best_match if best_match is not None else None)  # Ensure criteria matches final match
    final_weights.append(best_weight if best_weight is not None else None)

# Output the final selected items, indices, match criteria, and weights in the required format
OUT = (
    final_matched_items,      # Index 0: Best matched items from Master Family List
    final_matched_indices,    # Index 1: Indices of the best matched items in Master Family List
    match_criteria,           # Index 2: Original match criteria from matching logic inputs
    final_weights             # Index 3: Weights for each selected match
)
# ----------------------------------------
code_block_29 = CodeBlock { 0; }
list_getitematindex_mfl_list_1_6 = List.GetItemAtIndex(list=python_script, index=code_block_29)  # "List.GetItemAtIndex "MFL (List 1): Supplier Item""
code_block_30 = CodeBlock { 1; }
list_getitematindex_indices_6 = List.GetItemAtIndex(list=python_script, index=code_block_30)
code_block_31 = CodeBlock { 3; }
list_getitematindex_weights = List.GetItemAtIndex(list=python_script, index=code_block_31)
code_block_32 = CodeBlock { 2; }
list_getitematindex_takeoff_list_6 = List.GetItemAtIndex(list=python_script, index=code_block_32)  # "List.GetItemAtIndex "Takeoff (List 2): ACI_Supplier Item""

# group: Cleanup
mfl_list_1_6 = CodeBlock(x=list_getitematindex_mfl_list_1_6) { x; }
indices_6 = CodeBlock(x=list_getitematindex_indices_6) { x; }
weights = CodeBlock(x=list_getitematindex_weights) { x; }
takeoff_list_2_6 = CodeBlock(x=list_getitematindex_takeoff_list_6) { x; }

# group: Write Supplier Item to Master Check
exportToExcel = Data.ExportToExcel(filePath=file_path_4, sheetName=sheet_name, startRow=start_row, startColumn=start_column_2, data=mfl_list_1_6)

code_block_33 = CodeBlock(x=importExcel) { x; }

# group: Extract "[O] Supplier Index" from Takeoff to Write into Master Check for Start Column
firstItem_4 = List.FirstItem(list=code_block_33)
code_block_34 = CodeBlock { 2; }
getItemAtIndex_5 = List.GetItemAtIndex(list=firstItem_4, index=code_block_34)
string_6 = StringInput("[O] Supplier")
indexOf_4 = List.IndexOf(list=getItemAtIndex_5, element=string_6)

master_family_list = CodeBlock(x=importExcel_2) { x; }

# group: Extract "Supplier" from Master Family List
transpose_3 = List.Transpose(lists=master_family_list)
firstItem_5 = List.FirstItem(list=master_family_list)
string_7 = StringInput("Supplier")
indexOf_5 = List.IndexOf(list=firstItem_5, element=string_7)
getItemAtIndex_6 = List.GetItemAtIndex(list=transpose_3, index=indexOf_5)

index_in_1 = CodeBlock(x=indices_6) { x; }

# group: Condition "[O] Supplier"
python_script_2 = Python(IN[0]=getItemAtIndex_6, IN[1]=index_in_1)  # CPython3
# ---------- python_script_2.python (27 lines) ----------
# Load the Python Standard and DesignScript Libraries
import sys
import clr
clr.AddReference('ProtoGeometry')
from Autodesk.DesignScript.Geometry import *

# The inputs to this node will be stored as a list in the IN variables.
dataEnteringNode = IN

# Input Data
List1 = IN[0]  # List1 (the original list of Supplier Items)
Indices = IN[1]  # Indices from the first Python script (matching indices)

# Initialize an empty result list
outputList = []

# Iterate through Indices and place the corresponding Supplier Item from List1 into the correct position
for index in Indices:
    if index is not None and 0 <= index < len(List1):
        # If the index is valid, place the Supplier Item from List1 in the corresponding position
        outputList.append(List1[index])
    else:
        # If there's no match (index is None), append None to keep index structure
        outputList.append(None)

# Output the updated list with Supplier Items placed at the correct indices
OUT = outputList
# ----------------------------------------

# group: Write "[O] Supplier" to Master Check
exportToExcel_2 = Data.ExportToExcel(filePath=file_path_4, sheetName=sheet_name, startRow=start_row, startColumn=indexOf_4, data=python_script_2)

# group: Extract "[O] Description" Index from Takeoff to Write into Master Check for Start Column
firstItem_6 = List.FirstItem(list=code_block_33)
code_block_35 = CodeBlock { 2; }
getItemAtIndex_7 = List.GetItemAtIndex(list=firstItem_6, index=code_block_35)
string_8 = StringInput("[O] Description")
indexOf_6 = List.IndexOf(list=getItemAtIndex_7, element=string_8)

# group: Extract "Description" from Master Family List
transpose_4 = List.Transpose(lists=master_family_list)
firstItem_7 = List.FirstItem(list=master_family_list)
string_9 = StringInput("Description")
indexOf_7 = List.IndexOf(list=firstItem_7, element=string_9)
getItemAtIndex_8 = List.GetItemAtIndex(list=transpose_4, index=indexOf_7)

# group: Condition "[O] Description"
python_script_3 = Python(IN[0]=getItemAtIndex_8, IN[1]=index_in_1)  # CPython3; same code as python_script_2

# group: Write "[O] Description" to Master Check
exportToExcel_3 = Data.ExportToExcel(filePath=file_path_4, sheetName=sheet_name, startRow=start_row, startColumn=indexOf_6, data=python_script_3)

# group: Extract "[O] Revit EQ Category" Index from Takeoff to Write into Master Check for Start Column
firstItem_8 = List.FirstItem(list=code_block_33)
code_block_36 = CodeBlock { 2; }
getItemAtIndex_9 = List.GetItemAtIndex(list=firstItem_8, index=code_block_36)
string_10 = StringInput("[O] Revit EQ Category")
indexOf_8 = List.IndexOf(list=getItemAtIndex_9, element=string_10)

# group: Extract "Revit EQ Category" from Master Family List
transpose_5 = List.Transpose(lists=master_family_list)
firstItem_9 = List.FirstItem(list=master_family_list)
string_11 = StringInput("Revit EQ Category")
indexOf_9 = List.IndexOf(list=firstItem_9, element=string_11)
getItemAtIndex_10 = List.GetItemAtIndex(list=transpose_5, index=indexOf_9)

# group: Condition "[O] Revit EQ Category"
python_script_4 = Python(IN[0]=getItemAtIndex_10, IN[1]=index_in_1)  # CPython3; same code as python_script_2

# group: Write "[O] Revit EQ Catergory" to Master Check
exportToExcel_4 = Data.ExportToExcel(filePath=file_path_4, sheetName=sheet_name, startRow=start_row, startColumn=indexOf_8, data=python_script_4)

# group: Extract "[O] Revit EQ Tag" Index from Takeoff to Write into Master Check for Start Column
firstItem_10 = List.FirstItem(list=code_block_33)
code_block_37 = CodeBlock { 2; }
getItemAtIndex_11 = List.GetItemAtIndex(list=firstItem_10, index=code_block_37)
string_12 = StringInput("[O] Revit EQ Tag")
indexOf_10 = List.IndexOf(list=getItemAtIndex_11, element=string_12)

# group: Extract "Revit EQ Tag" from Master Family List
transpose_6 = List.Transpose(lists=master_family_list)
firstItem_11 = List.FirstItem(list=master_family_list)
string_13 = StringInput("Revit EQ Tag")
indexOf_11 = List.IndexOf(list=firstItem_11, element=string_13)
getItemAtIndex_12 = List.GetItemAtIndex(list=transpose_6, index=indexOf_11)

# group: Condition "[O] Revit EQ Tag"
python_script_5 = Python(IN[0]=getItemAtIndex_12, IN[1]=index_in_1)  # CPython3; same code as python_script_2

# group: Write "[O] Revit EQ Tag" to Master Check
exportToExcel_5 = Data.ExportToExcel(filePath=file_path_4, sheetName=sheet_name, startRow=start_row, startColumn=indexOf_10, data=python_script_5)

# group: Extract "[O] Attachment URL" Index from Takeoff to Write into Master Check for Start Column
firstItem_12 = List.FirstItem(list=code_block_33)
code_block_38 = CodeBlock { 2; }
getItemAtIndex_13 = List.GetItemAtIndex(list=firstItem_12, index=code_block_38)
string_14 = StringInput("[O] Attachment URL")
indexOf_12 = List.IndexOf(list=getItemAtIndex_13, element=string_14)

# group: Extract "Attachment URL" from Master Family List
transpose_7 = List.Transpose(lists=master_family_list)
firstItem_13 = List.FirstItem(list=master_family_list)
string_15 = StringInput("Attachment URL")
indexOf_13 = List.IndexOf(list=firstItem_13, element=string_15)
getItemAtIndex_14 = List.GetItemAtIndex(list=transpose_7, index=indexOf_13)

# group: Condition "[O] Attachment URL"
python_script_6 = Python(IN[0]=getItemAtIndex_14, IN[1]=index_in_1)  # CPython3; same code as python_script_2

# group: Write "[O] Attachment URL" to Master Check
exportToExcel_6 = Data.ExportToExcel(filePath=file_path_4, sheetName=sheet_name, startRow=start_row, startColumn=indexOf_12, data=python_script_6)

file_path_7 = CodeBlock(x=join_3) { x; }
file_path_8 = CodeBlock(x=file_path_7) { x; }
code_block_39 = CodeBlock(x=importExcel) { x; }

# group: Extract "[O] CA: Department" from Takeoff to Write into Master Check for Start Column
firstItem_14 = List.FirstItem(list=code_block_39)
code_block_40 = CodeBlock { 2; }
getItemAtIndex_15 = List.GetItemAtIndex(list=firstItem_14, index=code_block_40)
string_16 = StringInput("[O] CA: Department")
indexOf_14 = List.IndexOf(list=getItemAtIndex_15, element=string_16)

master_family_list_2 = CodeBlock(x=importExcel_2) { x; }

# group: Extract "CA: Department" from Master Family List
transpose_8 = List.Transpose(lists=master_family_list_2)
firstItem_15 = List.FirstItem(list=master_family_list_2)
string_17 = StringInput("CA: Department")
indexOf_15 = List.IndexOf(list=firstItem_15, element=string_17)
getItemAtIndex_16 = List.GetItemAtIndex(list=transpose_8, index=indexOf_15)

index_in_1_2 = CodeBlock(x=indices_6) { x; }

# group: Condition "[O] CA: Department"
python_script_7 = Python(IN[0]=getItemAtIndex_16, IN[1]=index_in_1_2)  # CPython3; same code as python_script_2

# group: Write "[O] CA: Department" to Master Check
exportToExcel_7 = Data.ExportToExcel(filePath=file_path_8, sheetName=sheet_name, startRow=start_row, startColumn=indexOf_14, data=python_script_7)

# group: Extract "[O] CA: Type" from Takeoff to Write into Master Check for Start Column
firstItem_16 = List.FirstItem(list=code_block_39)
code_block_41 = CodeBlock { 2; }
getItemAtIndex_17 = List.GetItemAtIndex(list=firstItem_16, index=code_block_41)
string_18 = StringInput("[O] CA: Type")
indexOf_16 = List.IndexOf(list=getItemAtIndex_17, element=string_18)

# group: Extract "CA: TYPE" from Master Family List
transpose_9 = List.Transpose(lists=master_family_list_2)
firstItem_17 = List.FirstItem(list=master_family_list_2)
string_19 = StringInput("CA: TYPE")
indexOf_17 = List.IndexOf(list=firstItem_17, element=string_19)
getItemAtIndex_18 = List.GetItemAtIndex(list=transpose_9, index=indexOf_17)

# group: Condition "[O] CA: Type"
python_script_8 = Python(IN[0]=getItemAtIndex_18, IN[1]=index_in_1_2)  # CPython3; same code as python_script_2

# group: Write "[O] CA: Type" to Master Check
exportToExcel_8 = Data.ExportToExcel(filePath=file_path_8, sheetName=sheet_name, startRow=start_row, startColumn=indexOf_16, data=python_script_8)

# group: Extract "[O] CA: LF" from Takeoff to Write into Master Check for Start Column
firstItem_18 = List.FirstItem(list=code_block_39)
code_block_42 = CodeBlock { 2; }
getItemAtIndex_19 = List.GetItemAtIndex(list=firstItem_18, index=code_block_42)
string_20 = StringInput("[O] LF")
indexOf_18 = List.IndexOf(list=getItemAtIndex_19, element=string_20)

# group: Extract "CA: LF" from Master Family List
transpose_10 = List.Transpose(lists=master_family_list_2)
firstItem_19 = List.FirstItem(list=master_family_list_2)
string_21 = StringInput("CA: LF")
indexOf_19 = List.IndexOf(list=firstItem_19, element=string_21)
getItemAtIndex_20 = List.GetItemAtIndex(list=transpose_10, index=indexOf_19)

# group: Condition "[O] CA: LF"
python_script_9 = Python(IN[0]=getItemAtIndex_20, IN[1]=index_in_1_2)  # CPython3; same code as python_script_2

# group: Write "[O] CA: LF" to Master Check
exportToExcel_9 = Data.ExportToExcel(filePath=file_path_8, sheetName=sheet_name, startRow=start_row, startColumn=indexOf_18, data=python_script_9)

# group: Extract "[O] CA: Count" from Takeoff to Write into Master Check for Start Column
firstItem_20 = List.FirstItem(list=code_block_39)
code_block_43 = CodeBlock { 2; }
getItemAtIndex_21 = List.GetItemAtIndex(list=firstItem_20, index=code_block_43)
string_22 = StringInput("[O] CNT")
indexOf_20 = List.IndexOf(list=getItemAtIndex_21, element=string_22)

# group: Extract "CA: Count" from Master Family List
transpose_11 = List.Transpose(lists=master_family_list_2)
firstItem_21 = List.FirstItem(list=master_family_list_2)
string_23 = StringInput("CA: Count")
indexOf_21 = List.IndexOf(list=firstItem_21, element=string_23)
getItemAtIndex_22 = List.GetItemAtIndex(list=transpose_11, index=indexOf_21)

# group: Condition "[O] CA: Count"
python_script_10 = Python(IN[0]=getItemAtIndex_22, IN[1]=index_in_1_2)  # CPython3; same code as python_script_2

# group: Write "[O] CA: Count" to Master Check
exportToExcel_10 = Data.ExportToExcel(filePath=file_path_8, sheetName=sheet_name, startRow=start_row, startColumn=indexOf_20, data=python_script_10)

# group: Extract "[O] CA: LSF" from Takeoff to Write into Master Check for Start Column
firstItem_22 = List.FirstItem(list=code_block_39)
code_block_44 = CodeBlock { 2; }
getItemAtIndex_23 = List.GetItemAtIndex(list=firstItem_22, index=code_block_44)
string_24 = StringInput("[O] LSF")
indexOf_22 = List.IndexOf(list=getItemAtIndex_23, element=string_24)

# group: Extract "CA: LSF" from Master Family List
transpose_12 = List.Transpose(lists=master_family_list_2)
firstItem_23 = List.FirstItem(list=master_family_list_2)
string_25 = StringInput("CA: LSF")
indexOf_23 = List.IndexOf(list=firstItem_23, element=string_25)
getItemAtIndex_24 = List.GetItemAtIndex(list=transpose_12, index=indexOf_23)

# group: Condition "[O] CA: LSF"
python_script_11 = Python(IN[0]=getItemAtIndex_24, IN[1]=index_in_1_2)  # CPython3; same code as python_script_2

# group: Write "[O] CA: LSF" to Master Check
exportToExcel_11 = Data.ExportToExcel(filePath=file_path_8, sheetName=sheet_name, startRow=start_row, startColumn=indexOf_22, data=python_script_11)

# group: Debug Perfect Matches
watch = Watch(mfl_list_1)
watch_2 = Watch(takeoff_list_2)
python_script_12 = Python(IN[0]=mfl_list_1)  # CPython3
# ---------- python_script_12.python (22 lines) ----------
# Load the Python Standard and DesignScript Libraries
import sys
import clr
clr.AddReference('ProtoGeometry')
from Autodesk.DesignScript.Geometry import *

# The inputs to this node will be stored as a list in the IN variables.
dataEnteringNode = IN

# Input: List of items
list_items = IN[0]

# Initialize the count to zero
non_null_count = 0

# Check if list_items is not None
if list_items is not None:
    # Count the non-null items
    non_null_count = sum(1 for item in list_items if item is not None)

# Output the count of non-null items
OUT = non_null_count
# ----------------------------------------
perfect_matches = Watch(python_script_12)

# group: Debug Partial Matches
watch_3 = Watch(mfl_list_1_2)
watch_4 = Watch(takeoff_list_2_2)
python_script_13 = Python(IN[0]=mfl_list_1_2)  # CPython3; same code as python_script_12
n6_char_matches = Watch(python_script_13)  # "6 Char Matches"

# group: Debug Partial Matches
python_script_14 = Python(IN[0]=mfl_list_1_3)  # CPython3; same code as python_script_12
n5_char_matches = Watch(python_script_14)  # "5 Char Matches"
watch_5 = Watch(takeoff_list_2_3)
watch_6 = Watch(mfl_list_1_3)

# group: Debug Partial Matches
python_script_15 = Python(IN[0]=mfl_list_1_4)  # CPython3; same code as python_script_12
n4_char_matches = Watch(python_script_15)  # "4 Char Matches"
watch_7 = Watch(takeoff_list_2_4)
watch_8 = Watch(mfl_list_1_4)

# group: Debug Partial Matches
python_script_16 = Python(IN[0]=mfl_list_1_5)  # CPython3; same code as python_script_12
n3_char_matches = Watch(python_script_16)  # "3 Char Matches"
watch_9 = Watch(mfl_list_1_5)
watch_10 = Watch(takeoff_list_2_5)

# group: Extract "[D] Strength" Index from Takeoff to Write into Master Check
firstItem_24 = List.FirstItem(list=importExcel)
code_block_45 = CodeBlock { 2; }
getItemAtIndex_25 = List.GetItemAtIndex(list=firstItem_24, index=code_block_45)
string_26 = StringInput("[D] Strength")
indexOf_24 = List.IndexOf(list=getItemAtIndex_25, element=string_26)

start_column_3 = CodeBlock(x=indexOf_24) { x; }
start_column_4 = CodeBlock(x=start_column_3) { x; }

# group: Write Strength to Master Check
exportToExcel_12 = Data.ExportToExcel(filePath=file_path_4, sheetName=sheet_name, startRow=start_row, startColumn=start_column_4, data=weights)

# group: Extract "[O] Supplier Index" from Takeoff to Write into Master Check for Start Column
firstItem_25 = List.FirstItem(list=code_block_33)
code_block_46 = CodeBlock { 2; }
getItemAtIndex_26 = List.GetItemAtIndex(list=firstItem_25, index=code_block_46)
string_27 = StringInput("Is Match?")
indexOf_25 = List.IndexOf(list=getItemAtIndex_26, element=string_27)

# group: Condition "Is Match?"
code_block_47 = CodeBlock { "Yes"; }
code_block_48 = CodeBlock { "No"; }
python_script_17 = Python(IN[0]=indices, IN[1]=code_block_47, IN[2]=code_block_48, IN[3]=drop_headers)  # CPython3
# ---------- python_script_17.python (32 lines) ----------
# Load the Python Standard and DesignScript Libraries
import sys
import clr
clr.AddReference('ProtoGeometry')
from Autodesk.DesignScript.Geometry import *

# The inputs to this node will be stored as a list in the IN variables.
dataEnteringNode = IN

# Inputs
Indices = IN[0]         # Indices with row numbers where "Yes" should be written (and None elsewhere)
yes_value = IN[1]       # Value to write for "Yes" entries
no_value = IN[2]        # Value to write for "No" entries
drop_rows = IN[3]       # Number of rows to drop from the beginning

# Determine the length of the output list
list_length = len(Indices)

# Initialize output list with "No" values for each row
outputList = [no_value] * list_length

# Iterate through Indices and replace the default "No" values with "Yes" for non-null values
for i in range(list_length):
    if Indices[i] is not None and i >= drop_rows:
        # Write the "Yes" value at the specified index
        outputList[i] = yes_value

# Output the final list with "Yes" and "No" values based on the indices, excluding the dropped rows
outputList = outputList[drop_rows:]

# Output the final list
OUT = outputList
# ----------------------------------------

# group: Write "Is Match" = "Yes" to Master Check
exportToExcel_13 = Data.ExportToExcel(filePath=file_path_4, sheetName=sheet_name, startRow=start_row, startColumn=indexOf_25, data=python_script_17)

# group: Debug Partial Matches
watch_11 = Watch(mfl_list_1_6)
watch_12 = Watch(takeoff_list_2_6)
python_script_18 = Python(IN[0]=mfl_list_1_6)  # CPython3; same code as python_script_12
n6_char_matches_2 = Watch(python_script_18)  # "6 Char Matches"

watch_13 = Watch(importExcel)
file_path_9 = CodeBlock(x=getItemAtIndex_4) { x; }
file_path_10 = CodeBlock(x=file_path_9) { x; }
watch_14 = Watch(list_getitematindex_indices_6)
watch_15 = Watch(weights)
