# Dynamo graph 04_Copy-Place_CA-Legend.dyn (Dynamo 2.16.2.5624)

# group: Copy "DSP Comp Ref" to Current Project and Place on Sheet > "DSP Comp Ref" Template Location
file_path = Filename("Templates\ACI_Project_Template.rte")

# group: Copy "DSP Comp Ref" to Current Project and Place on Sheet
code_block = CodeBlock { "DSP Comp Ref"; }
code_block_2 = CodeBlock { "FIXTURE PLAN"; }
code_block_3 = CodeBlock { [3.483, 2.695, 0.0]; }
copy_and_place_legend = Python(IN[0]=file_path, IN[1]=code_block, IN[2]=code_block_2, IN[3]=code_block_3)  # CPython3
# ---------- copy_and_place_legend.python (99 lines) ----------
import clr
clr.AddReference('RevitAPI')
clr.AddReference('RevitServices')
clr.AddReference('System')

from System import Guid
from System.Collections.Generic import List
from Autodesk.Revit.DB import *
from RevitServices.Persistence import DocumentManager
from RevitServices.Transactions import TransactionManager

# Get the current Revit document (the active project)
doc = DocumentManager.Instance.CurrentDBDocument

# Inputs from Dynamo
template_path = IN[0]  # File path to the Revit template (RVT) file
legend_name = IN[1]  # Name of the Legend View to extract
sheet_name = IN[2]   # Name of the sheet to place the legend on
placement_location = IN[3]  # XYZ coordinates for the placement of the legend (tuple/list)

copied_legend_id = None
legend_on_sheet_id = None

try:
    # Start a transaction to remove any existing legend with the same name
    TransactionManager.Instance.EnsureInTransaction(doc)
    existing_legend = next((view for view in FilteredElementCollector(doc).OfClass(View)
                            if view.ViewType == ViewType.Legend and view.Name == legend_name), None)

    if existing_legend:
        doc.Delete(existing_legend.Id)
    TransactionManager.Instance.TransactionTaskDone()

    # Open the Revit template document
    app = doc.Application
    template_doc = app.OpenDocumentFile(template_path)

    try:
        # Find the legend view by name in the template file
        legend_view = next((view for view in FilteredElementCollector(template_doc).OfClass(View)
                            if view.ViewType == ViewType.Legend and view.Name == legend_name), None)

        if legend_view is None:
            OUT = f"Error: Legend view named '{legend_name}' not found in the template."
        else:
            # Start a transaction to copy the legend into the current document
            TransactionManager.Instance.EnsureInTransaction(doc)

            # Copy the legend to the current project
            element_ids = List[ElementId]([legend_view.Id])
            copied_ids = ElementTransformUtils.CopyElements(template_doc, element_ids, doc, Transform.Identity, CopyPasteOptions())

            TransactionManager.Instance.TransactionTaskDone()

            # Get the copied legend
            copied_legend_id = copied_ids[0]
            copied_legend = doc.GetElement(copied_legend_id)
    finally:
        # Ensure the template document is closed properly
        if template_doc.IsValidObject:
            template_doc.Close(False)

    # Locate the sheet where the legend should be placed
    sheet = next((s for s in FilteredElementCollector(doc).OfClass(ViewSheet) if s.Name == sheet_name), None)

    if sheet is None:
        OUT = f"Error: Sheet named '{sheet_name}' not found in the current project."
    else:
        # Start a transaction to either place or move the legend on the sheet
        TransactionManager.Instance.EnsureInTransaction(doc)

        # Convert placement_location to XYZ
        x, y, z = placement_location
        position = XYZ(x, y, z)

        try:
            # Place the legend view on the sheet using Viewport.Create
            viewport = Viewport.Create(doc, sheet.Id, copied_legend.Id, position)

            if viewport is None:
                OUT = f"Error: Could not place the legend '{legend_name}' on sheet '{sheet_name}'."
            else:
                legend_on_sheet_id = viewport.Id
                OUT = [
                    f"Legend '{legend_name}' successfully placed on sheet '{sheet_name}' at position ({x}, {y}, {z}).",
                    copied_legend_id.IntegerValue,
                    legend_on_sheet_id.IntegerValue
                ]
        except Exception as e:
            TransactionManager.Instance.ForceCloseTransaction()
            OUT = f"Error during placement: {e}"

        TransactionManager.Instance.TransactionTaskDone()

except Exception as e:
    OUT = f"Error: {e}"

# Output only the relevant result
OUT = OUT
# ----------------------------------------

watch = Watch(copy_and_place_legend)
code_block_4 = CodeBlock { 2; }
getItemAtIndex = List.GetItemAtIndex(list=copy_and_place_legend, index=code_block_4)
set_legend_properties = Python(IN[0]=getItemAtIndex)  # CPython3
# ---------- set_legend_properties.python (75 lines) ----------
import clr
clr.AddReference('RevitAPI')
clr.AddReference('RevitServices')

from Autodesk.Revit.DB import *
from RevitServices.Persistence import DocumentManager
from RevitServices.Transactions import TransactionManager

# Get the current Revit document
doc = DocumentManager.Instance.CurrentDBDocument

# Inputs from Dynamo
legend_on_sheet_id = IN[0]  # Element ID of the legend on the sheet

try:
    # Convert input to ElementId
    legend_on_sheet_element_id = ElementId(legend_on_sheet_id)
    legend_on_sheet = doc.GetElement(legend_on_sheet_element_id)

    # Verify if the element is found
    if legend_on_sheet is None:
        OUT = f"Error: No element found with ID {legend_on_sheet_id}."
    elif not isinstance(legend_on_sheet, Viewport):
        OUT = f"Error: Element with ID {legend_on_sheet_id} is not a Viewport."
    else:
        # Start a transaction to inspect the Viewport properties
        TransactionManager.Instance.EnsureInTransaction(doc)

        try:
            # Debugging: Collect and output all properties of the Viewport
            debug_info = {}
            debug_info['Element ID'] = legend_on_sheet.Id.IntegerValue
            debug_info['View Name'] = doc.GetElement(legend_on_sheet.ViewId).Name if legend_on_sheet.ViewId else "<None>"
            debug_info['Sheet Name'] = doc.GetElement(legend_on_sheet.SheetId).Name if legend_on_sheet.SheetId else "<None>"
            debug_info['Viewport Type'] = legend_on_sheet.GetType().Name
            debug_info['Category'] = legend_on_sheet.Category.Name if legend_on_sheet.Category else "<None>"

            # Collect all parameters of the Viewport for detailed inspection
            parameters_info = {}
            for param in legend_on_sheet.Parameters:
                try:
                    if param.StorageType == StorageType.String:
                        param_value = param.AsString() if param.HasValue else "<No Value>"
                    elif param.StorageType == StorageType.ElementId:
                        element_id = param.AsElementId()
                        param_value = doc.GetElement(element_id).Name if element_id != ElementId.InvalidElementId else "<No Value>"
                    elif param.StorageType == StorageType.Double:
                        param_value = param.AsDouble()
                    elif param.StorageType == StorageType.Integer:
                        param_value = param.AsInteger()
                    else:
                        param_value = "<Unsupported Storage Type>"
                    
                    parameters_info[param.Definition.Name] = {
                        "Value": param_value,
                        "Is Read Only": param.IsReadOnly,
                        "Parameter Type": param.Definition.ParameterType.ToString()
                    }
                except Exception as e:
                    parameters_info[param.Definition.Name] = f"<Error reading value: {e}>"

            debug_info['Parameters'] = parameters_info

            OUT = f"Debug Info: {debug_info}"

        except Exception as e:
            OUT = f"Error: {e}"
        finally:
            TransactionManager.Instance.TransactionTaskDone()

except Exception as e:
    OUT = f"Error: {e}"

# Output the result
OUT = OUT
# ----------------------------------------
watch_2 = Watch(set_legend_properties)
python_script = Python()  # CPython3
# ---------- python_script.python (56 lines) ----------
import clr
clr.AddReference('RevitServices')
clr.AddReference('RevitAPI')
clr.AddReference('RevitNodes')
clr.AddReference('RevitAPIUI')

from RevitServices.Persistence import DocumentManager
from Autodesk.Revit.DB import FilteredElementCollector, BuiltInCategory, Viewport, ElementType

# Get the current Revit document
doc = DocumentManager.Instance.CurrentDBDocument

# Collect all elements in the project that belong to the Viewport category
viewport_collector = FilteredElementCollector(doc).OfCategory(BuiltInCategory.OST_Viewports).WhereElementIsNotElementType()

# Initialize list to store viewport family information
viewport_info = []

# Loop through collected elements and extract relevant information
for viewport in viewport_collector:
    if isinstance(viewport, Viewport):
        try:
            # Safely get the view name
            view_element = doc.GetElement(viewport.ViewId)
            view_name = view_element.Name if view_element is not None else "Unknown View"
        except AttributeError:
            view_name = "Unknown View - Attribute Error"
        except Exception as e:
            view_name = f"Unknown View - Error: {str(e)}"
        
        try:
            # Get the ElementType (Family Type) for the viewport
            type_id = viewport.GetTypeId()
            family_type = doc.GetElement(type_id)
            
            # Check if family_type is ElementType and assign the correct name
            if family_type is None:
                type_name = "Unknown - Type ID could not be resolved"
            elif isinstance(family_type, ElementType):
                type_name = family_type.FamilyName if hasattr(family_type, 'FamilyName') else family_type.Name if hasattr(family_type, 'Name') else "Unknown Element Type Name"
            else:
                type_name = f"Unknown - Retrieved type is {type(family_type)}"
        except AttributeError:
            type_name = "Unknown Type - Attribute Error"
        except Exception as e:
            type_name = f"Unknown Type - Error: {str(e)}"
        
        # Append information about the viewport
        viewport_info.append({
            "Viewport ID": viewport.Id.IntegerValue,
            "Viewport Name": view_name,
            "Viewport Type": type_name
        })

# Output the result
OUT = viewport_info
# ----------------------------------------
watch_3 = Watch(python_script)
python_script_2 = Python()  # CPython3
# ---------- python_script_2.python (76 lines) ----------
import clr
clr.AddReference('RevitServices')
clr.AddReference('RevitAPI')
clr.AddReference('RevitNodes')
clr.AddReference('RevitAPIUI')

from RevitServices.Persistence import DocumentManager
from Autodesk.Revit.DB import FilteredElementCollector, BuiltInCategory, Viewport, ElementType

# Get the current Revit document
doc = DocumentManager.Instance.CurrentDBDocument

# Collect all elements in the project that belong to the Viewport category
viewport_collector = FilteredElementCollector(doc).OfCategory(BuiltInCategory.OST_Viewports).WhereElementIsNotElementType()

# Collect all element types that belong to the Viewport category
viewport_type_collector = FilteredElementCollector(doc).OfClass(ElementType).OfCategory(BuiltInCategory.OST_Viewports)

# Initialize list to store viewport family information
viewport_info = []
viewport_types_info = []

# Loop through collected viewports and extract relevant information
for viewport in viewport_collector:
    if isinstance(viewport, Viewport):
        try:
            # Safely get the view name
            view_element = doc.GetElement(viewport.ViewId)
            view_name = view_element.Name if view_element is not None else "Unknown View"
        except Exception as e:
            view_name = f"Unknown View - Error: {str(e)}"
        
        try:
            # Get the ElementType (Family Type) for the viewport
            type_id = viewport.GetTypeId()
            family_type = doc.GetElement(type_id)
            
            # Check if family_type is ElementType and assign the correct name
            if isinstance(family_type, ElementType) and hasattr(family_type, 'Name'):
                type_name = family_type.Name
            else:
                type_name = "Unknown - Could not resolve type name"
        except Exception as e:
            type_name = f"Unknown Type - Error: {str(e)}"
        
        # Append information about the viewport
        viewport_info.append({
            "Viewport ID": viewport.Id.IntegerValue,
            "Viewport Name": view_name,
            "Viewport Type": type_name
        })

# Loop through collected viewport types and extract relevant information
for viewport_type in viewport_type_collector:
    try:
        if hasattr(viewport_type, 'Name'):
            viewport_types_info.append({
                "Viewport Type ID": viewport_type.Id.IntegerValue,
                "Viewport Type Name": viewport_type.Name
            })
        else:
            viewport_types_info.append({
                "Viewport Type ID": "Unknown",
                "Viewport Type Name": "Unknown - Property could not be read"
            })
    except Exception as e:
        viewport_types_info.append({
            "Viewport Type ID": "Error",
            "Viewport Type Name": f"Error: {str(e)}"
        })

# Output the result
OUT = {
    "Viewports": viewport_info,
    "Viewport Types": viewport_types_info
}
# ----------------------------------------
watch_4 = Watch(python_script_2)
